# Grasshopper definition Rhino8_CityJSON_Grasshopper.gh (Grasshopper 1.0.7)
# plug-ins: RhinoCityJSON

# Insert your file path
toggle = BooleanToggle(False)
rsettings = SettingsReader(Translate=False, TrueNorth=0, LoD=Slider(1, range=0..1), LargeFiles=False)
dreader = ReaderDocuments(Activate=toggle, Settings=rsettings)  # -> MetadataInformation, LoD, Materials, Domain
baking = Bakery(Activate=False)
preview = CustomPreview(
    Geometry=dreader.MetadataInformation,
    Material={diffuse=RGB(228, 178, 227), emission=RGB(68, 53, 68), shine=0.5, specular=RGB(255, 254, 255), transparency=0})
